# Grasshopper definition GH01_GeomConversionTesting.gh (Grasshopper 1.0.6)
# plug-ins: UserDataUtils

# ---- group: Select something in rhino and click this dude
rsel = RhSelection(x=Toggle(False))  # -> out, A
# ---------- rsel: C# usings ----------
using System.IO;
using System.Linq;
using System.Data;
using System.Drawing;
using System.Reflection;
using System.Windows.Forms;
using System.Xml;
using System.Xml.Linq;
using System.Runtime.InteropServices;

using Rhino.DocObjects;
using Rhino.Collections;
using GH_IO;
using GH_IO.Serialization;
# ---------- rsel: C# ----------
    A = RhinoDoc.ActiveDoc.Objects.GetSelectedObjects(true, true).Select(xxx => xxx.Geometry);
# ---------- end rsel ----------

# ----
srl = Serialiser(Object=rsel.A)  # -> ConversionResultString, ConversionResult
eo = ExpandObject(Object=srl.ConversionResult)  # -> Type, Radius, Center, Normal, Plane, Domain, Hash, Transform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
dsr = Deserialiser(Object=srl.ConversionResult)
srl_2 = Serialiser(Object=dsr)  # -> ConversionResultString, ConversionResult
eo_2 = ExpandObject(Object=srl_2.ConversionResult)  # -> Type, Radius, Center, Normal, Plane, Domain, Hash, Transform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
c_script = CSharpScript(x=eo_2.Radius, y=eo.Radius)  # -> out, A; inputs x: String, y: String
# ---------- c_script: C# ----------
    A = x == y;
# ---------- end c_script ----------
geo = Geometry(dsr)
are_the_hashes_equal = Panel(c_script.A)
